# Grasshopper definition SpeckleSuiteSend_example.gh (Grasshopper 0.9.76)
# plug-ins: Weaverbird, SpeckleSuite

pt = ConstructPoint(XCoordinate=Slider(14, range=0..100), YCoordinate=0, ZCoordinate=0)
number_slider = Slider(2.3, range=0.1..10)
number_slider_2 = Slider(11, range=0..25)
number_slider_3 = Slider(0, range=0..3)
wbicosahedron = WeaverbirdsMeshMeshIcosahedron(Plane=pt, Radius=5)
wbframe = WeaverbirdsPictureFrame(MeshPolylines=wbicosahedron, Distance=number_slider_2, InsetType=0)
wbthicken = WeaverbirdsMeshThicken(MeshCurves=wbframe, Distance=number_slider, OffsetType=0)
wbcatmullclark = WeaverbirdsCatmullClarkSubdivision(MeshCurves=wbthicken, Level=number_slider_3, SmoothNakedEdges=1)
num = Number("12")
moist_stream = SpeckleStreamSender(Frame=number_slider_2, Thickness=number_slider, SubdivLevels=number_slider_3, Mesh=wbcatmullclark, STREAM_ID="H1ncYHrU")
